# Grasshopper definition centeredCurveDivider.gh (Grasshopper 1.0.7)

crv = Curve(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)
python = GhPythonScript(crv=crv, gap=Slider(3000, range=500..3000), centerIsPt=Toggle(True), discardEnds=Slider(0.5, range=0..1))  # -> divPts; inputs crv: Curve, centerIsPt: Boolean
# ---------- python: Python ----------
"""
Accurately divide a curve with division points centered on the curve
"""

__author__ = "fzh31635"
__version__ = "2021.10.12"

import ghpythonlib.components as ghcomp

# set descriptions
ghenv.Component.Params.Input[0].Description = "Curve to be divided"
ghenv.Component.Params.Input[1].Description = "Accurate gap between division points"
ghenv.Component.Params.Input[2].Description = "Center is a point if on, gap if off"
ghenv.Component.Params.Input[3].Description = "If set, ends smaller than given portion of the gap will be discarded"
ghenv.Component.Params.Output[0].Description = "Division points"

# calculate basic values
l = ghcomp.Length(crv)
halfCount = int( (l/2)//gap )

# find division positions
## if center is a point
if centerIsPt:
    pos = [l/2]
    cur1 = l/2
    cur2 = l/2
    
    for i in range(halfCount):
        cur1 -= gap
        cur2 += gap
        pos.append(cur1)
        pos.append(cur2)
## if center is a gap
else:
    cur1 = l/2-gap/2
    cur2 = l/2+gap/2
    pos = [cur1, cur2]
    
    for i in range(halfCount-1):
        cur1 -= gap
        cur2 += gap
        pos.append(cur1)
        pos.append(cur2)

pos.sort()

# Discard Ends
if discardEnds:
    if pos[0] < discardEnds * gap:
        pos = pos[1:]
    if pos[-1] > l - discardEnds * gap:
        pos = pos[:-1]

# Generate points
divPts = ghcomp.EvaluateLength(crv, pos, False)[0]
# ---------- end python ----------
